# Grasshopper definition compare_contour.gh (Grasshopper 1.0.8)
# plug-ins: Tunny

x1 = Slider(0.01, range=-0.6..0.5)
x2 = Slider(-0.97, range=-1.25..-0.4)
c_script = CSharpScript(x1=x1, x2=x2)  # -> out, A; inputs x1: Double, x2: Double
# ---------- c_script: C# ----------
    var a1 = x1 + x2 + 1;
    var a2 = 19 - (14 * x1) + (3 * x1 * x1) - (14 * x2) + (6 * x1 * x2) + (3 * x2 * x2);
    var a = 1 + (a1 * a1) * a2;

    var b1 = (2 * x1) - (3 * x2);
    var b2 = 18 - (32 * x1) + (12 * x1 * x1) + (48 * x2) - (36 * x1 * x2) + (27 * x2 * x2);
    var b = 30 + (b1 * b1) * b2;

    A = a * b;
# ---------- end c_script ----------
goldstein_price_function = Number(c_script.A)
tunny = Tunny(Variables=[x1, x2], Objectives=goldstein_price_function)
