# Grasshopper definition opt-speed_check.gh (Grasshopper 1.0.8)
# plug-ins: Tunny

x = Slider(0.14, range=0..10)
y = Slider(0.12, range=0..10)
addition = Addition(A=x, B=y)
galapagos = Galapagos(fitness=add, gene=[x, y])
add = Number(addition)
tunny = Tunny(Variables=[x, y], Objectives=add)
