# Grasshopper definition section_ML.gh (Grasshopper 1.0.8)
# plug-ins: Tunny, Karamba3D, RhinoCodePluginGH, LunchBoxML

# ---- group: 学習データ作成 / 梁断面
genes = GenePool(Decimals=0, Maximum=317, Minimum=0, Value=[192, 298, 156, 146])

# ---- group: 学習データ作成 / 柱断面
column_section = GenePool(Decimals=0, Maximum=113, Minimum=0, Value=[110, 113])

# ---- group: 学習データ作成
crosec = CrossSectionKaramba3D([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])
crosecrselect = CrossSectionRangeSelectorKaramba3D(CrossSections=crosec, MaximumHeight_mm=-1, MaximumWidth_mm=-1, menu=[dropdown(1), dropdown(1), dropdown(0)])
crosecrselect_2 = CrossSectionRangeSelectorKaramba3D(
    CrossSections=crosec,
    MaximumHeight_mm=-1,
    MaximumWidth_mm=Slider(1000, range=0..1000),
    menu=[dropdown(1), dropdown(2), dropdown(0)])
number_slider = Slider(800, range=0..1000)
cross_section = CrossSectionKaramba3D(
    FamilyNameOfCrossSection="DefaultCroSec",
    Height_mm=Slider(1200, range=0..10000),
    UpperFlangeWidth_mm=number_slider,
    LowerFlangeWidth_mm=number_slider,
    mode="Trapezoid")
matselect = MaterialSelectionKaramba3D(menu=[dropdown(7), dropdown(5)])
item = ListItem(List=crosecrselect_2, Index=graft(column_section), Wrap=True)
item_2 = ListItem(List=crosecrselect, Index=graft(genes), Wrap=True)
fb = Curve([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])
sb1 = Curve([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])
sb2 = Curve([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])
sg1 = Curve([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])
sg2 = Curve([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])
sc1 = Curve([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])
sc2 = Curve([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])
number_slider_2 = Slider(0.2, range=0..1)
number_slider_3 = Slider(1, range=0..10)
bang = ExplodeTree(Data=item)  # -> Branch0, Branch1
entwine = Entwine(Branch00=fb, Branch01=sb1, Branch02=sb2, Branch03=sg1, Branch04=sg2, Branch05=sc1, Branch06=sc2, FlattenInputs=True)
panel = Panel("""FB
SB1
SB2
SG1
SG2
SC1
SC2""")
bang_2 = ExplodeTree(Data=item_2)  # -> Branch0, Branch1, Branch2, Branch3
number_slider_4 = Slider(1, range=0..1)
X = UnitX(Factor=number_slider_2)
pt = Point([Point(6448.750012, -19480.5, -19980), Point(6448.750012, -11680.5, -19980), Point(6448.750012, -3880.5, -19980), Point(6448.750012, 3919.5, -19980), Point(6448.750012, 11719.5, -19980), Point(6448.750012, 19519.5, -19980), Point(-6551.249988, 19519.5, -19980), Point(-6551.249988, 11719.5, -19980), Point(-6551.249988, 3919.5, -19980), Point(-6551.249988, -3880.5, -19980), Point(-6551.249988, -11680.5, -19980), Point(-6551.249988, -19480.5, -19980)])
Y = UnitY(Factor=number_slider_2)
Y_2 = UnitY(Factor=number_slider_3)
graft = GraftTree(Tree=panel, IncludeEmptyLists=True, IncludeNullItems=True)
X_2 = UnitX(Factor=number_slider_3)
cross_section_2 = CrossSectionKaramba3D(FamilyNameOfCrossSection="DefaultCroSec", Material=matselect, Height_mm=Slider(150, range=0..1000), mode="Shell - Const")
cross_section_3 = CrossSectionKaramba3D(FamilyNameOfCrossSection="DefaultCroSec", Material=matselect, Height_mm=Slider(600, range=0..1000), mode="Shell - Const")
entwine_2 = Entwine(
    Branch00=cross_section,
    Branch01=bang_2.Branch0,
    Branch02=bang_2.Branch1,
    Branch03=bang_2.Branch2,
    Branch04=bang_2.Branch3,
    Branch05=bang.Branch0,
    Branch06=bang.Branch1,
    FlattenInputs=True)
supp = SupportKaramba3D(PosInd=pt, menu=[buttons(on, on, on, off, off, off)])
基礎スラブ = Surface([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])
床スラブ = Surface([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])
loads = LoadsKaramba3D(Vector=X, LCase="0", mode="Gravity")
loads_2 = LoadsKaramba3D(Vector=Y, LCase=number_slider_4, mode="Gravity")
entwine_3 = Entwine(Branch00=基礎スラブ, Branch01=床スラブ, FlattenInputs=True)
loads_3 = LoadsKaramba3D(
    Vector=Y_2,
    Mesh=flatten(entwine_3),
    LCase=number_slider_4,
    mode="MeshLoad -Const.",
    menu=[buttons(off, on, off), buttons(on, on)])
loads_4 = LoadsKaramba3D(Vector=X_2, Mesh=flatten(entwine_3), LCase="0", mode="MeshLoad -Const.", menu=[buttons(off, on, off), buttons(on, on)])
linetobeam = LineToBeamKaramba3D(
    Line=entwine,
    Identifier=graft,
    CrossSection=entwine_2,
    New=True,
    Remove=True,
    LimitDistance_mm=0.005,
    Bending=True,
    SetBucklingLength=True,
    ToPolylineMaxAngle=0.03,
    ToPolylineTolerance=0.01,
    ToPolylineMaxEdgeLength=0.25)  # -> flatten(Element), Points, Info
entwine_4 = Entwine(Branch00=cross_section_3, Branch01=cross_section_2, FlattenInputs=True)
load = LoadKaramba3D([loads, loads_2, loads_4, loads_3])
meshtoshell = MeshToShellKaramba3D(Mesh=entwine_3, CrossSection=entwine_4, LimitDistance_mm=0.005)  # -> flatten(Element), Points, Info
assemble = AssembleModelKaramba3D(Elem=[linetobeam.Element, meshtoshell.Element], Support=supp, Load=load, LimitDistance_mm=0.005)  # -> Model, Info, Mass_kg, CenterOfGravity, LoadCaseNames
analyze = AnalyzeKaramba3D(Model=assemble.Model)  # -> CalculatedModel, MaximumDisplacement_mm, ResultingForceOfGravity_N, ElasticEnergyChange_kNm
disassemble = DisassembleCrossSectionKaramba3D(CroSec=entwine_2)  # -> CrossSection, FamilyNameOfCrossSection, TypeNameOfCrossSection, ElemIdentifiers, Color, Material, LocalEccentricity_mm, Heights_mm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
disp_point = Point([Point(6448.750012, -3880.5, -19980), Point(6448.750012, -3880.5, -15980), Point(6448.750012, -3880.5, -11980), Point(6448.750012, -3880.5, -7980), Point(6448.750012, -3880.5, -3980), Point(6448.750012, -3880.5, 20), Point(6448.750012, -3880.5, 4020), Point(6448.750012, -3880.5, 8020), Point(6448.750012, -3880.5, 12020), Point(6448.750012, -3880.5, 16020), Point(6448.750012, -3880.5, 20020)])
modelview = ModelViewKaramba3D(Model=analyze.CalculatedModel, ResultFactors=1, ResultCase=Slider(0, range=0..1))  # -> Model, DeformedMesh, DeformedAxes, DeformedModel
nodedisp = NodalDisplacementsKaramba3D(AnalyzedModel=analyze.CalculatedModel, PositionsIndexes=disp_point, LoadCase=Slider(1, range=0..1))  # -> AnalyzedModel, NodalTranslations_m, NodalRotations_rad
nodedisp_2 = NodalDisplacementsKaramba3D(AnalyzedModel=analyze.CalculatedModel, PositionsIndexes=disp_point, LoadCase=Slider(0, range=0..1))  # -> AnalyzedModel, NodalTranslations_m, NodalRotations_rad
flatten = FlattenTree(Tree=disassemble.TypeNameOfCrossSection, Path="{0}")
shellview = ShellViewKaramba3D(Model=modelview.Model, IndexOfLayer=0)  # -> Model, MeshesOfRenderedShells, LegendColors, LegendTags
beamview = BeamViewKaramba3D(Model=modelview.Model)  # -> Model, MeshesOfRenderedBeams, DeformedBeamAxes, LegendColors, LegendTags
vlen = VectorLength(Vector=nodedisp.NodalTranslations_m)
vlen_2 = VectorLength(Vector=nodedisp_2.NodalTranslations_m)
split = SplitList(List=flatten, Index=Slider(1, range=0..1))  # -> ListA, ListB
cs = CSharpScript(height=Slider(4, range=0..10), x_disps=vlen_2, y_disps=vlen)  # -> out, rad, disp; inputs height: Double, x_disps: list of Double, y_disps: list of Double
# ---------- cs: C# ----------
// Grasshopper Script Instance
using System;
using System.Collections;
using System.Collections.Generic;
using System.Drawing;

using Rhino;
using Rhino.Geometry;

using Grasshopper;
using Grasshopper.Kernel;
using Grasshopper.Kernel.Data;
using Grasshopper.Kernel.Types;

using System.Linq;

public class Script_Instance : GH_ScriptInstance
{
  /* 
    Members:
      RhinoDoc RhinoDocument
      GH_Document GrasshopperDocument
      IGH_Component Component
      int Iteration

    Methods (Virtual & overridable):
      Print(string text)
      Print(string format, params object[] args)
      Reflect(object obj)
      Reflect(object obj, string method_name)
  */
  
  private void RunScript(
	double height,
	IList<double> x_disps,
	IList<double> y_disps,
	ref object rad,
	ref object disp)
  {
    var x_floorDisp = new List<double>();
    var y_floorDisp = new List<double>();
    for(var i = 1 ; i < x_disps.Count; i++)
    {
        x_floorDisp.Add(x_disps[i] - x_disps[i-1]);
        y_floorDisp.Add(y_disps[i] - y_disps[i-1]);
    }

    if (x_floorDisp.Max() > y_floorDisp.Max())
    {
        rad = x_floorDisp.Max() / height;
        disp = x_floorDisp.Max();
    }
    else
    {
        rad = y_floorDisp.Max() / height;
        disp = y_floorDisp.Max();
    }
  }
}
# ---------- end cs ----------
division = Division(A=Slider(1, range=0..1), B=Slider(200, range=0..1000))
constrfa = ConstructFishAttribute(CrossSections=split.ListB, Max_rad=cs.rad)
max_disp = Number(cs.disp)
panel_2 = Panel([cs.rad, division])
tunny = Tunny(Variables=[genes, column_section], Objectives=max_disp, Attributes=constrfa)

# ---- group: 機械学習
qmc = Fish([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])
deconf = DeconstructFish(Fishes=qmc)  # -> NumberVariables, TextVariables, Objectives, Attributes
varidate = Fish([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])
number_slider_5 = Slider(10, range=2..30)
number_slider_6 = Slider(9, range=0..20)
number_slider_7 = Slider(255, range=10..300)
number_slider_8 = Slider(0.076, range=0.01..0.2)
deconf_2 = DeconstructFish(Fishes=varidate)  # -> NumberVariables, TextVariables, Objectives, Attributes
panel_3 = Panel("""SB1
SB2
SG1
SG2
SC1
SC2
max_disp""")
merge = Merge(Data1=deconf.NumberVariables, Data2=deconf.Objectives)
merge_2 = Merge(Data1=deconf_2.NumberVariables, Data2=deconf_2.Objectives)
create = CreateDataSet(Labels=panel_3, Data=merge)
light_gbm = LightGBMRegression(
    NumberOfLeaves=number_slider_5,
    NumberOfIterations=number_slider_7,
    MinimumExampleCountPerLeaf=number_slider_6,
    LearningRate=number_slider_8)
column_label = GetColumnLabel(Data=create, columns="SB1,SB2,SG1,SG2,SC1,SC2,max_disp")  # -> SB1, SB2, SG1, SG2, SC1, SC2, Max_disp
create_2 = CreateDataSet(Labels=panel_3, Data=merge_2)
regression_trainer = RegressionTrainer(
    TrainingDataSet=create,
    FeatureNames=[column_label.SB1, column_label.SB2, column_label.SG1, column_label.SG2, column_label.SC1, column_label.SC2],
    LabelName=column_label.Max_disp,
    TrainerType=light_gbm)
regression_tester = RegressionTester(Model=regression_trainer, TestingDataSet=create_2)  # -> Predictions, R2, AbsoluteLoss, SquaredLoss, RootMeanSquaredLoss
rms_loss = Number(regression_tester.RootMeanSquaredLoss)
tunny_2 = Tunny(Variables=[number_slider_5, number_slider_7, number_slider_6, number_slider_8], Objectives=rms_loss)

# ---- group: 解析結果と機械学習結果比較
panel_4 = Panel("""SB1
SB2
SG1
SG2
SC1
SC2
max_disp""")
karamba_の変形 = Number(max_disp)
梁断面番号 = Number(genes)
柱断面番号 = Number(column_section)
学習モデル = Data(regression_trainer)
断面名 = Text(split.ListB)
merge_3 = Merge(Data1=梁断面番号, Data2=柱断面番号, Data3=Slider(0, range=0..100))
create_3 = CreateDataSet(Labels=panel_4, Data=merge_3)
regression_tester_2 = RegressionTester(Model=学習モデル, TestingDataSet=create_3)  # -> Predictions, R2, AbsoluteLoss, SquaredLoss, RootMeanSquaredLoss
panel_5 = Panel("""SB1: 
SB2: 
SG1: 
SG2: 
SC1: 
SC2: """)
division_2 = Division(A=Slider(4, range=0..10), B=regression_tester_2.Predictions)
division_3 = Division(A=[regression_tester_2.Predictions, karamba_の変形], B=4)
concat = Concatenate(FragmentA="1/層間変形角：", FragmentB=division_2)
neg = Negative(Value=Slider(4388, range=0..10000))
concat_2 = Concatenate(FragmentA=panel_5, FragmentB=断面名)
division_4 = Division(A=Slider(1, range=0..1), B=division_3)
Z = UnitZ(Factor=neg)
pt_2 = Point(Point(5892.386147, 43603.02253, 10530.38992))
item_3 = ListItem(List=flatten(division_4), Index=0, Wrap=True)  # -> Item, Item1
_1_層間変形角 = Panel(division_4)
arrlinear = LinearArray(Geometry=pt_2, Direction=Z, Count=10)  # -> Geometry, Transform
division_5 = Division(A=item_3.Item, B=item_3.Item1)
panel_6 = Panel(division_5)
tag = TextTag(Location=arrlinear.Geometry, Text=flatten([concat, concat_2]))
